# Grasshopper definition boundary_making_test.gh (Grasshopper 1.0.7)

panel = Panel("""135.57094801
135.56746301
135.56754201
135.56754401
135.56755701
135.56755701
135.56755701
135.56755701
135.56760701
135.56764401
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""")
panel_2 = Panel("""34.59286300
34.59392501
34.59374001
34.59371101
34.59353101
34.59351201
34.59348101
34.59332901
34.59324501
34.59317701
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""")
pt = ConstructPoint(XCoordinate=panel_2, YCoordinate=panel, ZCoordinate=0)
pline = PolyLine(Vertices=pt, Closed=False)
srf = Surface(pline)
