# Grasshopper definition csvversion.gh (Grasshopper 1.0.7)

file = ReadFile(F="C:\_Python\GML-Grasshopper-connection\area_用途地域.csv", PerLineParse=True)  # -> C
#   port F: Uri of file to read
# ---------- file: VB line parser ----------
    action = GH_LineParserAction.Include
    Return line

    'Parse the line and return some data that represents the line.
    'If the line cannot be parsed, you can return Nothing and
    'assign a different action.
    'The default implementation is to just return the line itself.
    'If you return types that implement IGH_Goo, this component
    'will work substantially faster.
# ---------- end file ----------
split = TextSplit(Text=file, Separators=",")
panel = Panel("""1
2
3
4
5
6
7
8
9
10
11
12
13""")
panel_2 = Panel("""第一種低層住居専用地域
第二種低層住居専用地域
第一種中高層住居専用地域
第二種中高層住居専用地域
第一種住居地域
第二種住居地域
準住居地域
近隣商業地域
商業地域
準工業地域
工業地域
工業専用地域
不明""")
keysearch = KeyValueSearch(Keys=panel_2, Values=panel, Search=split)
keysearch_2 = KeyValueSearch(Keys=panel_2, Values=panel, Search=panel_2)
gradient = Gradient(
    LowerLimit="1",
    UpperLimit="20",
    Parameter=keysearch,
    stops=[0: RGB(243, 57, 0), 0: RGB(14, 75, 98), 0: RGB(122, 112, 201), 0.1: RGB(236, 27, 60), 0.2: RGB(210, 0, 118), 0.3: RGB(103, 0, 120), 0.4: RGB(39, 72, 161), 0.5: RGB(1, 192, 229), 0.6: RGB(18, 178, 90), 0.7: RGB(79, 186, 8)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])
gradient_2 = Gradient(
    LowerLimit="1",
    UpperLimit="13",
    Parameter=keysearch_2,
    stops=[0: RGB(243, 57, 0), 0: RGB(14, 75, 98), 0: RGB(122, 112, 201), 0.1: RGB(236, 27, 60), 0.2: RGB(210, 0, 118), 0.3: RGB(103, 0, 120), 0.4: RGB(39, 72, 161), 0.5: RGB(1, 192, 229), 0.6: RGB(18, 178, 90), 0.7: RGB(79, 186, 8)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])
rec = Rectangle({Plane=PlaneXY(136017.5797, 34610.27775, 0), Size=Domain2(u=-213.3017565..213.3017565, v=-126.4874748..126.4874748)})
legend = Legend(Colour=gradient_2, Tags=panel_2, Rectangle=rec, LegendType=1)

file_2 = ReadFile(F="C:\_Python\GML-Grasshopper-connection\points_id.csv", PerLineParse=True)  # -> C; same code as file
file_3 = ReadFile(F="C:\_Python\GML-Grasshopper-connection\points_y.csv", PerLineParse=True)  # -> C; same code as file
file_4 = ReadFile(F="C:\_Python\GML-Grasshopper-connection\points_x.csv", PerLineParse=True)  # -> C; same code as file
split_2 = TextSplit(Text=file_2, Separators=",")
split_3 = TextSplit(Text=file_3, Separators=",")
split_4 = TextSplit(Text=file_4, Separators=",")
multiplication = Multiplication(A=split_3, B="1000")
multiplication_2 = Multiplication(A=split_4, B="1000")
pt = ConstructPoint(XCoordinate=multiplication, YCoordinate=multiplication_2, ZCoordinate="0")
pline = PolyLine(Vertices=pt, Closed="1")

file_5 = ReadFile(F="C:\_Python\GML-Grasshopper-connection\srf_ex_crv_id.csv", PerLineParse=True)  # -> C; same code as file
file_6 = ReadFile(F="C:\_Python\GML-Grasshopper-connection\srf_in_crv_id.csv", PerLineParse=True)  # -> C; same code as file
file_7 = ReadFile(F="C:\_Python\GML-Grasshopper-connection\srf_id.csv", PerLineParse=True)  # -> C; same code as file
split_5 = TextSplit(Text=file_7, Separators=",")
split_6 = TextSplit(Text=file_5, Separators=",")
split_7 = TextSplit(Text=file_6, Separators=",")

keysearch_3 = KeyValueSearch(Keys=flatten(split_2), Values=flatten(pline), Search=split_7)
keysearch_4 = KeyValueSearch(Keys=flatten(split_2), Values=flatten(pline), Search=split_6)
preview = CustomPreview(Geometry=keysearch_3, Material=ColourSwatch(SwatchColor=RGB(128, 0, 255)))
preview_2 = CustomPreview(Geometry=keysearch_4, Material=ColourSwatch(SwatchColor=RGB(255, 0, 0)))
merge = Merge(Data1=keysearch_4, Data2=keysearch_3)
boundary = BoundarySurfaces(Edges=merge)

file_8 = ReadFile(F="C:\_Python\GML-Grasshopper-connection\area_容積率.csv", PerLineParse=True)  # -> C; same code as file
split_8 = TextSplit(Text=file_8, Separators=",")
sort = SortList(Keys=split_8)  # -> Keys, ValuesA
dcon = DeleteConsecutive(Set=sort.Keys, Wrap=False)  # -> flatten(Set), Count
gradient_3 = Gradient(
    LowerLimit="80",
    UpperLimit="1000",
    Parameter=split_8,
    stops=[0: RGB(234, 38, 0), 0.25: RGB(234, 126, 0), 0.5: RGB(254, 244, 84), 0.75: RGB(173, 203, 249), 1: RGB(75, 107, 169)])
gradient_4 = Gradient(
    LowerLimit="80",
    UpperLimit="1000",
    Parameter=dcon.Set,
    stops=[0: RGB(234, 38, 0), 0.25: RGB(234, 126, 0), 0.5: RGB(254, 244, 84), 0.75: RGB(173, 203, 249), 1: RGB(75, 107, 169)])
rec_2 = Rectangle({Plane=PlaneXY(136017.5797, 34610.27775, 0), Size=Domain2(u=-213.3017565..213.3017565, v=-126.4874748..126.4874748)})
legend_2 = Legend(Colour=gradient_4, Tags=dcon.Set, Rectangle=rec_2, LegendType=1)
area = Area(Geometry=boundary)  # -> Area, flatten(Centroid)
tag = TextTag(Location=area.Centroid, Text=split_8)
preview_3 = CustomPreview(Geometry=flatten(boundary), Material=gradient_3)

file_9 = ReadFile(F="C:\_Python\GML-Grasshopper-connection\area_建ぺい率.csv", PerLineParse=True)  # -> C; same code as file
split_9 = TextSplit(Text=file_9, Separators=",")
sort_2 = SortList(Keys=split_9)  # -> Keys, ValuesA
dcon_2 = DeleteConsecutive(Set=sort_2.Keys, Wrap=False)  # -> flatten(Set), Count
gradient_5 = Gradient(
    LowerLimit="40",
    UpperLimit="100",
    Parameter=split_9,
    stops=[0: RGB(243, 57, 0), 0.1: RGB(236, 27, 60), 0.2: RGB(210, 0, 118), 0.3: RGB(103, 0, 120), 0.4: RGB(39, 72, 161), 0.5: RGB(1, 192, 229), 0.6: RGB(18, 178, 90), 0.7: RGB(79, 186, 8), 0.8: RGB(220, 237, 32), 0.9: RGB(247, 159, 20), 1: RGB(243, 57, 0)])
gradient_6 = Gradient(
    LowerLimit="40",
    UpperLimit="100",
    Parameter=dcon_2.Set,
    stops=[0: RGB(243, 57, 0), 0.1: RGB(236, 27, 60), 0.2: RGB(210, 0, 118), 0.3: RGB(103, 0, 120), 0.4: RGB(39, 72, 161), 0.5: RGB(1, 192, 229), 0.6: RGB(18, 178, 90), 0.7: RGB(79, 186, 8), 0.8: RGB(220, 237, 32), 0.9: RGB(247, 159, 20), 1: RGB(243, 57, 0)])
rec_3 = Rectangle({Plane=PlaneXY(136017.5797, 34610.27775, 0), Size=Domain2(u=-213.3017565..213.3017565, v=-126.4874748..126.4874748)})
legend_3 = Legend(Colour=gradient_6, Tags=dcon_2.Set, Rectangle=rec_3, LegendType=1)
area_2 = Area(Geometry=boundary)  # -> Area, flatten(Centroid)
tag_2 = TextTag(Location=area_2.Centroid, Text=split_8)
preview_4 = CustomPreview(Geometry=flatten(boundary), Material=gradient_5)

area_3 = Area(Geometry=boundary)  # -> Area, flatten(Centroid)
tag_3 = TextTag(Location=area_3.Centroid, Text=split)
preview_5 = CustomPreview(Geometry=flatten(boundary), Material=gradient)
