# Grasshopper definition ghpythontest.gh (Grasshopper 1.0.7)
# plug-ins: GH_CPython

rep = ReplaceText(Find="'", RecursiveReplace=False)
rep_2 = ReplaceText(Find="'", RecursiveReplace=False)
crv = Curve([<curve referenced from the Rhino model> x4])
crv_2 = Curve([<curve referenced from the Rhino model> x2])
rep_3 = ReplaceText(Text=rep, Find=" ", RecursiveReplace=False)
rep_4 = ReplaceText(Text=rep_2, Find=" ", RecursiveReplace=False)
gh_cpython = GH_CPython(x="5")  # -> a, b; inputs x: list
# ---------- gh_cpython: Python ----------
# -*- coding: utf-8 -*-
""" 
Python Script
Created on  Sunday December 2019 09:08:26 
@author:  novuf 

[desc]
Description of the plugin Here
Write here any thing... 
[/desc]

"""

from lxml import etree


def join_list2gh(listitem):
    list_1 = []
    for i in listitem:
        list_1.append(",".join(map(str, i)))
    flatten = "+".join(list_1)
    return flatten


gml_filepath = "C:\_Python\GML-Grasshopper-connection\GML_files\A29-11_26_GML\A29-11_26.xml"

# ##################################################
# delete invalid xmlns
# ##################################################

with open(gml_filepath, "r", encoding="utf-8_sig") as f:
    gml_data = f.read()

gml_data = gml_data.replace(
    "xmlns:schemaLocation=\"http://nlftp.mlit.go.jp/ksj/schemas/ksj-app KsjAppSchema-A29-v1_0.xsd\"", "")

with open(gml_filepath, "w", encoding="utf-8_sig") as f:
    f.write(gml_data)

# ##################################################
# making property list
# ##################################################

tree = etree.parse(gml_filepath)
root = tree.getroot()

mynsmap = {}
mynsmap = root.nsmap
# need define xml name apce again to ue lxml

crv_id = [i.attrib["{http://www.opengis.net/gml/3.2}id"]
          for i in root.iterfind('gml:Curve', namespaces=mynsmap)]
crv_pt_x = [i.text.split()[0::2] for i in root.iterfind(
    'gml:Curve/gml:segments/gml:LineStringSegment/gml:posList', namespaces=mynsmap)]
crv_pt_y = [i.text.split()[1::2] for i in root.iterfind(
    'gml:Curve/gml:segments/gml:LineStringSegment/gml:posList', namespaces=mynsmap)]

srf_id = [i.attrib["{http://www.opengis.net/gml/3.2}id"]
          for i in root.iterfind('gml:Surface', namespaces=mynsmap)]
# srf_ex_crv_id = [i.attrib["{http://www.w3.org/1999/xlink}href"].replace("#", "")
#                  for i in root.iterfind('gml:Surface/gml:patches/gml:PolygonPatch/gml:exterior/gml:Ring/gml:curveMember', namespaces=mynsmap)]
# srf_in_crv_id = [i.attrib["{http://www.w3.org/1999/xlink}href"].replace("#", "")
#                  for i in root.iterfind('gml:Surface/gml:patches/gml:PolygonPatch/gml:interior/gml:Ring/gml:curveMember', namespaces=mynsmap)]

srf = [i for i in root.iterfind('gml:Surface', namespaces=mynsmap)]

srf_ex_elm = [i.findall(
    "gml:patches/gml:PolygonPatch/gml:exterior/gml:Ring/gml:curveMember", namespaces=mynsmap) for i in srf]
srf_ex_crv_id = [[n.attrib["{http://www.w3.org/1999/xlink}href"]
                  .replace("#", "") for n in i] for i in srf_ex_elm]

srf_in_elm = [i.findall(
    "gml:patches/gml:PolygonPatch/gml:interior/gml:Ring/gml:curveMember", namespaces=mynsmap) for i in srf]
srf_in_crv_id = [[n.attrib["{http://www.w3.org/1999/xlink}href"]
                  .replace("#", "") for n in i] for i in srf_in_elm]

area_id = [i.attrib["{http://www.w3.org/1999/xlink}href"].replace("#", "")
           for i in root.iterfind('ksj:DesignatedArea/ksj:cda', namespaces=mynsmap)]
area_aac = [i.text for i in root.iterfind(
    'ksj:DesignatedArea/ksj:aac', namespaces=mynsmap)]
area_pfn = [i.text for i in root.iterfind(
    'ksj:DesignatedArea/ksj:pfn', namespaces=mynsmap)]
area_lgn = [i.text for i in root.iterfind(
    'ksj:DesignatedArea/ksj:lgn', namespaces=mynsmap)]
area_dac = [i.text for i in root.iterfind(
    'ksj:DesignatedArea/ksj:dac', namespaces=mynsmap)]
area_kda = [i.text for i in root.iterfind(
    'ksj:DesignatedArea/ksj:kda', namespaces=mynsmap)]
area_bar = [i.text for i in root.iterfind(
    'ksj:DesignatedArea/ksj:bar', namespaces=mynsmap)]
area_cbr = [i.text for i in root.iterfind(
    'ksj:DesignatedArea/ksj:cbr', namespaces=mynsmap)]
area_src = [i.text for i in root.iterfind(
    'ksj:DesignatedArea/ksj:src', namespaces=mynsmap)]

crv_ditc = {key: {"x": ptx, "y": ptx}
            for key, ptx, pty in zip(crv_id, crv_pt_x, crv_pt_y)}

srf_ditc = {key: {"ex": exc, "in": inc}
            for key, exc, inc in zip(srf_id, srf_ex_crv_id, srf_in_crv_id)}

final_x = []
final_y = []

for k, v in srf_ditc.items():
    final_x.append([crv_ditc[i]["x"] for i in v["ex"]])  # list_ex_x
    final_x.append([crv_ditc[i]["x"] for i in v["in"]])  # list_in_x
    final_y.append([crv_ditc[i]["y"] for i in v["ex"]])  # list_ex_y
    final_y.append([crv_ditc[i]["y"] for i in v["in"]])  # list_in_y

a = join_list2gh(final_x)
b = join_list2gh(final_y)

print("end")
# ---------- end gh_cpython ----------
pt = ConstructPoint(XCoordinate=rep_3, YCoordinate=rep_4, ZCoordinate=0)
split = TextSplit(Text=gh_cpython.b, Separators="+")
split_2 = TextSplit(Text=gh_cpython.a, Separators="+")
pline = PolyLine(Vertices=pt, Closed=False)
split_3 = TextSplit(Text=split, Separators=",")
split_4 = TextSplit(Text=split_2, Separators=",")
srf = Surface(pline)
pt_2 = ConstructPoint(XCoordinate=split_3, YCoordinate=split_4, ZCoordinate=0)
pline_2 = PolyLine(Vertices=pt_2, Closed=Toggle(True))
panel = Panel(split_4)
